# Grasshopper definition Day2.gh (Grasshopper 1.0.7)

# ----
# Ladybug_Import_epw
path = FilePath("C:\Users\jhan2harvard\Dropbox\E_Work\Jterm\Introduction-to-Data-Science-for-Building-Simulation-Harvard-GSD-JTerm-master\Day1\USA_MA_Boston-Logan.Intl.AP.725090_TMY3 - Copy.epw")
# Harvard GSD J-term class :
# Intro to data science and buildign performance simulation.
# This .gh file is created by Ellie Jungmin Han.
# __author__ = "jhan2harvard"
# __version__ = "2022.1.4"
importepw = Ladybug_ImportEpw(epwFile=path)  # -> readMe, latitude, location, dryBulbTemperature, dewPointTemperature, relativeHumidity, windSpeed, windDirection; plug-in component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

# ---- group: myPythonCode
# Write and Read a File
toggle = BooleanToggle(False)
path_2 = FilePath("C:\Users\ellie\Dropbox\E_Work\Jterm\Day2\myFile.txt")
myfile_reader = MyFileReader(INPUT=path_2)  # -> out, a, b
# ---------- myfile_reader: Python ----------
__author__ = "jhan2harvard"
__version__ = "2022.14"

import rhinoscriptsyntax as rs
import scriptcontext as sc
import json
import Rhino as r

ghenv.Component.Name = "myFileReader"
ghenv.Component.NickName = 'MyFile-Reader'

def OpenCSV(fn): # function for opening a txt file.
    file = open(fn, 'r')
    lines = file.readlines()
    file.close()
    return lines

d = OpenCSV(INPUT)

pts = []
values = []

for i, d in enumerate(d): # loop through lines
    if(i != 0):
        # Write your code here
        """
        # Call your lines with variables
        
        
        
        # creates a points list
        
        
        # creates a value list
        
        
        """

a= pts
b= values
# ---------- end myfile_reader ----------
myfile_writer = MyFileWriter(write=toggle)  # -> out, a; inputs points: list, values: list
# ---------- myfile_writer: Python ----------
__author__ = "jhan2harvard"
__version__ = "2022.14"

import rhinoscriptsyntax as rs
import json
import Rhino as r
import os

ghenv.Component.Name = "myFileWriter"
ghenv.Component.NickName = 'MyFile-Writer'

gh_path = ghdoc.Path # Get GH document's file path
file_name = "Rad.txt" # Create text file name
dir = os.path.dirname(os.path.realpath(gh_path))
file = os.path.join(dir, file_name) # Create text file path
filePath = open(file, "w") # Open text file to create it

if write:
    filePath = open(file, "w") # Open the file
    for i, point in enumerate(points): # Iterate through lines
        # Write your code here
        print point[1]
        """
        # Store your lines to variables
        
        
        # Write separate lines
        
        """
    filePath.close() # Close the file
else:
    msg = "Set 'write' to True."
    ghenv.Component.AddRuntimeMessage(gh.Kernel.GH_RuntimeMessageLevel.Warning, msg)
# ---------- end myfile_writer ----------
pt = Point(myfile_reader.a)

# ----
# Create Sky model
number_slider = Slider(1, range=0..10)
gencumulativeskymtx = Ladybug_GenCumulativeSkyMtx(epwFile=path, skyDensity=0, useOldRes=True, runIt=Toggle(True))  # -> out, cumulativeSkyMtx; plug-in component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
analysisperiod = Ladybug_AnalysisPeriod(
    fromMonth=number_slider,
    fromDay=Slider(1, range=0..100),
    fromHour=Slider(1, range=0..10),
    toMonth=Slider(12, range=0..12),
    toDay=Slider(31, range=0..100),
    toHour=Slider(24, range=0..100))  # -> readMe, analysisPeriod; plug-in component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
selectskymtx = Ladybug_selectSkyMtx(
    cumulativeSkyMtx=gencumulativeskymtx.cumulativeSkyMtx,
    analysisPeriod=analysisperiod.analysisPeriod,
    removeDiffuse=False,
    removeDirect=False)  # -> out, selectedSkyMtx; plug-in component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

# ---- group: Visualization
data = Data()
bnd = Bounds(Numbers=data)
dedomain = DeconstructDomain(Domain=bnd)  # -> Start, End
gradient = Gradient(
    LowerLimit=dedomain.End,
    UpperLimit=dedomain.Start,
    Parameter=data,
    stops=[0: RGB(234, 38, 0), 0.25: RGB(234, 126, 0), 0.5: RGB(254, 244, 84), 0.75: RGB(173, 203, 249), 1: RGB(75, 107, 169)])
pt_2 = Point(pt)
cloud = CloudDisplay(Points=pt_2, Colours=gradient, Size=Slider(1, range=0..1), SpriteType=0)

# ----
# Draw Radiation map
number_slider_2 = Slider(1, range=0..100)
brep = Brep([<brep referenced from the Rhino model> x5])
brep_2 = Brep(<brep referenced from the Rhino model>)
boolean_toggle = BooleanToggle(True)
radiationanalysis = Ladybug_RadiationAnalysis(
    geometry=flatten(brep_2),
    context=flatten(brep),
    gridSize=number_slider_2,
    disFromBase=Slider(0.5, range=0..1),
    selectedSkyMtx=flatten(selectskymtx.selectedSkyMtx),
    parallel=boolean_toggle,
    runIt=boolean_toggle)  # -> out, contextMesh, analysisMesh, flatten(testPts), testVec, port, flatten(radiationResult), radiationMesh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; plug-in component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
