# Grasshopper definition Day3.gh (Grasshopper 1.0.7)

# Harvard GSD J-term class :
# Intro to data science and buildign performance simulation.
# This .gh file is created by Ellie Jungmin Han.
# __author__ = "jhan2harvard"
# __version__ = "2022.1.4"
ladybug = Ladybug_Ladybug()  # -> Vviiiiiiiiiizzz; plug-in component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

# ----
# Ladybug_Import_epw
path = FilePath("C:\Users\jhan2harvard\Dropbox\E_Work\Jterm\Day1\USA_MA_Boston-Logan.Intl.AP.725090_TMY3.epw")
importepw = Ladybug_ImportEpw(epwFile=path)  # -> readMe, latitude, location, dryBulbTemperature, dewPointTemperature, relativeHumidity, windSpeed, windDirection; plug-in component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

number_slider = Slider(11, range=1..12)

# ----
# Draw Sun-path
panel = Panel("24")
series = Series(Start="1", Step=1, Count=panel)
sunpath = Ladybug_SunPath(
    location=importepw.location,
    hour=Slider(13, range=0..100),
    day="21",
    month=number_slider,
    timeStep=1,
    dailyOrAnnualSunPath=True)  # -> readMe, sunVectors, sunAltitudes, sunAzimuths, port, sunSpheresMesh, sunPathCrvs, compassCrvs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; plug-in component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

# ----
# Create Sky model
number_slider_2 = Slider(1, range=0..10)
gencumulativeskymtx = Ladybug_GenCumulativeSkyMtx(epwFile=path, skyDensity=0, useOldRes=True, runIt=Toggle(True))  # -> out, cumulativeSkyMtx; plug-in component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
analysisperiod = Ladybug_AnalysisPeriod(
    fromMonth=number_slider_2,
    fromDay=Slider(1, range=0..100),
    fromHour=Slider(1, range=0..10),
    toMonth=Slider(6, range=0..12),
    toDay=Slider(31, range=0..100),
    toHour=Slider(24, range=0..100))  # -> readMe, analysisPeriod; plug-in component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
selectskymtx = Ladybug_selectSkyMtx(
    cumulativeSkyMtx=gencumulativeskymtx.cumulativeSkyMtx,
    analysisPeriod=analysisperiod.analysisPeriod,
    removeDiffuse=False,
    removeDirect=False)  # -> out, selectedSkyMtx; plug-in component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

component_guid = CSharpScript(
    input=number_slider,
    TooltipDescriptionOverride="Displays the GUID for Grasshopper Canvas Components Useful for RhinoScript/PythonScript Automation",
    TooltipTextOverride="Gets the GUID of a Grasshopper Component")  # -> out, GUID
# ---------- component_guid: C# ----------
    List<Guid> guids = new List<Guid>();
    foreach (Grasshopper.Kernel.IGH_Param param in Component.Params.Input)
    {
      foreach(IGH_Param source in param.Sources)
      {
        guids.Add(source.InstanceGuid);
      }
    }

    GUID = guids;
# ---------- end component_guid ----------
panel_2 = Panel(component_guid.GUID)

# ----
# Draw Radiation map
brep = Brep(<brep referenced from the Rhino model>)
brep_2 = Brep([<brep referenced from the Rhino model> x5])
boolean_toggle = BooleanToggle(False)
radiationanalysis = Ladybug_RadiationAnalysis(
    geometry=flatten(brep),
    context=flatten(brep_2),
    gridSize=Slider(1, range=0..100),
    disFromBase=Slider(0.5, range=0..1),
    selectedSkyMtx=flatten(selectskymtx.selectedSkyMtx),
    parallel=boolean_toggle,
    runIt=boolean_toggle)  # -> out, contextMesh, analysisMesh, flatten(testPts), testVec, port, flatten(radiationResult), radiationMesh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; plug-in component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

brep_3 = Brep(<brep referenced from the Rhino model>)
brep_4 = Brep([<brep referenced from the Rhino model> x5])

# ----
# Draw Shadow map
panel_3 = Panel("5")
lng = ListLength(List=sunpath.sunVectors)
gradientlibrary = Ladybug_GradientLibrary(gradIndex=panel_3)  # -> customColors; plug-in component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
addition = Addition(A=lng, B=1)
legendpar = Ladybug_LegendParameters(numSegments=addition, customColors=flatten(gradientlibrary))  # -> legendPar; plug-in component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
toggle = BooleanToggle(True)
sunlighthoursanalysis = Ladybug_SunlightHoursAnalysis(
    geometry=flatten(brep_3),
    context=flatten(brep_4),
    gridSize="0.5",
    disFromBase="0.01",
    sunVectors=flatten(sunpath.sunVectors),
    timeStep=1,
    legendPar=flatten(legendpar),
    parallel=toggle,
    runIt=toggle)  # -> readMe, contextMesh, analysisMesh, testPts, testVec, port, sunlightHoursResult, sunlightHoursMesh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; plug-in component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

# ---- group: myPythonCode
# Write and Read a File
toggle_2 = BooleanToggle(True)
path_2 = FilePath("C:\Users\jhan2harvard\Dropbox\E_Work\Jterm\J_Term_2022\Ex\myResult.txt")
myfile_reader = MyFileReader(INPUT=path_2)  # -> out, a, b
# ---------- myfile_reader: Python ----------
__author__ = "jhan2harvard"
__version__ = "2022.14"

import rhinoscriptsyntax as rs
import scriptcontext as sc
import json
import Rhino as r

ghenv.Component.Name = "myFileReader"
ghenv.Component.NickName = 'MyFile-Reader'

def OpenCSV(fn): # function for opening a txt file.
    file = open(fn, 'r')
    lines = file.readlines()
    file.close()
    return lines

d = OpenCSV(INPUT)

pts = []
values = []

for i, d in enumerate(d): # loop through lines
    if(i != 0):
        print (d)
        # Write your code here
        # Call your lines with variables
        myResult = d.split(",")
        x = myResult[0]
        y = myResult[1]
        z = myResult[2]
        Val = myResult[3]
        pts.append(r.Geometry.Point3d(float(x),float(y),float(z)))
        values.append(float(Val))
       

a= pts
b= values
# ---------- end myfile_reader ----------
myfile_writer = MyFileWriter(
    param=number_slider,
    points=sunlighthoursanalysis.testPts,
    values=sunlighthoursanalysis.sunlightHoursResult,
    write=toggle_2)  # -> out, a; inputs param: Int32, points: list, values: list
# ---------- myfile_writer: Python ----------
__author__ = "jhan2harvard"
__version__ = "2022.14"

import rhinoscriptsyntax as rs
import json
import Rhino as r
import os

ghenv.Component.Name = "myFileWriter"
ghenv.Component.NickName = 'MyFile-Writer'

gh_path = ghdoc.Path # Get GH document's file path
file_name =  "myResult,"+str(param)+".txt" # Create text file name
dir = os.path.dirname(os.path.realpath(gh_path))
file = os.path.join(dir+"/param/", file_name) # Create text file path
filePath = open(file , "w") # Open text file to create it

if write:
    filePath = open(file, "w") # Open the file
    for i, point in enumerate(points): # Iterate through lines
        # Write your code here
        print (point)
        myPoint = point.split(",")
        x = myPoint[0]
        y = myPoint[1]
        z = myPoint[2]
        # Store your lines to variables
        Val = values[i]
        filePath.write(str(x)+","+str(y)+","+str(z)+","+ str(Val) +"\n")
        # Write separate lines
        

    filePath.close() # Close the file
else:
    msg = "Set 'write' to True."
    ghenv.Component.AddRuntimeMessage(gh.Kernel.GH_RuntimeMessageLevel.Warning, msg)
# ---------- end myfile_writer ----------
pt = Point(myfile_reader.a)

# ---- group: Visualization
data = Data(myfile_reader.b)
bnd = Bounds(Numbers=data)
dedomain = DeconstructDomain(Domain=bnd)  # -> Start, End
gradient = Gradient(
    LowerLimit=dedomain.End,
    UpperLimit=dedomain.Start,
    Parameter=data,
    stops=[0: RGB(234, 38, 0), 0.25: RGB(234, 126, 0), 0.5: RGB(254, 244, 84), 0.75: RGB(173, 203, 249), 1: RGB(75, 107, 169)])
pt_2 = Point(pt)
cloud = CloudDisplay(Points=pt_2, Colours=gradient, Size=Slider(1, range=0..1), SpriteType=0)

# ----
pt_3 = Point(sunlighthoursanalysis.testPts)
